# Grasshopper definition 04_003_005_Difference_of_two_Squares.gh (Grasshopper 1.0.7)
# plug-ins: RhinoCodePluginGH

# ----
# PARAMETRIC SCRIPT
number_slider = Slider(2.176, range=0..10)
# Use this script editor template to create a script
#  for the C# node in grasshopper for rhino8 that
# models geometry for the Difference of Two Squares: //
# Grasshopper Script Instance
# //#! csharp
# using System;
# using System.Collections;
# using System.Collections.Generic;
# using System.Drawing;
# 
# using Rhino;
# using Rhino.Geometry;
# 
# using Grasshopper;
# using Grasshopper.Kernel;
# using Grasshopper.Kernel.Data;
# using Grasshopper.Kernel.Types;
# 
# public class Script_Instance : GH_ScriptInstance
# {
#   /*
#     Members:
#       RhinoDoc RhinoDocument
#       GH_Document GrasshopperDocument
#       IGH_Component Component
#       int Iteration
# 
#     Methods (Virtual & overridable):
#       Print(string text)
#       Print(string format, params object[] args)
#       Reflect(object obj)
#       Reflect(object obj, string method_name)
#   */
# 
#   private void RunScript(object x, object y, out object a)
#   {
#     // Write your logic here
#     a = null;
#   }
# }
number_slider_2 = Slider(7.2, range=0..10)  # disabled
# 2nd gpt-4 Text Prompt
# Great, now make the script much more complex model
# with C# script and Rhino common API.
# 
# Be sure to incorporate the previous code logic.
# ensure that this script produces 3d geometry as
# well for Data visualization purposes.
number_slider_3 = Slider(2.72, range=0..10)  # disabled
difference_of_two_squares = Script(a=Slider(0.122, range=0..10), b=number_slider)  # -> out, boxAplusB, boxAminusB; inputs a: Double, b: Double
# ---------- difference_of_two_squares: C# ----------
using System;
using System.Collections;
using System.Collections.Generic;
using System.Drawing;

using Rhino;
using Rhino.Geometry;

using Grasshopper;
using Grasshopper.Kernel;
using Grasshopper.Kernel.Data;
using Grasshopper.Kernel.Types;

public class Script_Instance : GH_ScriptInstance
{
  private void RunScript(double a, double b, out object boxAplusB, out object boxAminusB)
  {
    double side1 = a + b;
    double side2 = a - b;

    // Define the X, Y, and Z intervals for boxes
    Interval xInterval1 = new Interval(0, side1);
    Interval yInterval1 = new Interval(0, side1);
    Interval zInterval1 = new Interval(0, side1 * side1);

    Interval xInterval2 = new Interval(0, side2);
    Interval yInterval2 = new Interval(0, side2);
    Interval zInterval2 = new Interval(0, side2 * side2);

    // Create 3D boxes using the intervals
    boxAplusB = new Box(Plane.WorldXY, xInterval1, yInterval1, zInterval1);
    boxAminusB = new Box(Plane.WorldXY, xInterval2, yInterval2, zInterval2);
  }
}
# ---------- end difference_of_two_squares ----------
# Visualize Mathematics
# with C#  in Grasshopper
# at Wickerson Studios
# 004 ALGEBRA & ARITHMETIC
# 4.3 Algebraic Expansion
# 04_003_05_Differemce_of_two_Squares
# BASIC SCRIPT
# gpt-4 Text Prompt
difference_of_two_squares_2 = Script(a=number_slider_2, b=number_slider_3)  # -> out, squareAplusB, squareAminusB; inputs a: Double, b: Double; disabled
# ---------- difference_of_two_squares_2: C# ----------
using System;
using System.Collections;
using System.Collections.Generic;
using System.Drawing;

using Rhino;
using Rhino.Geometry;

using Grasshopper;
using Grasshopper.Kernel;
using Grasshopper.Kernel.Data;
using Grasshopper.Kernel.Types;

public class Script_Instance : GH_ScriptInstance
{
  /* 
    Members:
      RhinoDoc RhinoDocument
      GH_Document GrasshopperDocument
      IGH_Component Component
      int Iteration

    Methods (Virtual & overridable):
      Print(string text)
      Print(string format, params object[] args)
      Reflect(object obj)
      Reflect(object obj, string method_name)
  */
  
  private void RunScript(double a, double b, out object squareAplusB, out object squareAminusB)
  {
    double side1 = a + b;
    double side2 = a - b;

    // Assuming the base point is at the origin for both squares
    Point3d basePt = Point3d.Origin;

    // Create the squares
    squareAplusB = new Rectangle3d(Plane.WorldXY, basePt, new Point3d(basePt.X + side1, basePt.Y + side1, basePt.Z));
    squareAminusB = new Rectangle3d(Plane.WorldXY, basePt, new Point3d(basePt.X + side2, basePt.Y + side2, basePt.Z));
  }
}
# ---------- end difference_of_two_squares_2 ----------
panel = Panel(difference_of_two_squares.out)
geometry = Geometry(difference_of_two_squares_2.squareAplusB)  # disabled
# Alright! Let's enhance the previous script to
# produce more intricate 3D geometry using the
# Rhino Common API, while incorporating the
# logic from the previous code.
# 
# Let's visualize the difference of squares using
# both 2D squares and 3D boxes:
# 
# We'll generate two 2D squares as before.
# We'll create two 3D boxes with heights
# corresponding to their areas to represent
geometry_2 = Geometry(difference_of_two_squares_2.squareAminusB)  # disabled
geometry_3 = Geometry(difference_of_two_squares.boxAplusB)
geometry_4 = Geometry(difference_of_two_squares.boxAminusB)
# Sure, I can help you with that!
# 
# Given the formula for the Difference of Two Squares:
# a ^2−b ^2
#  =(a+b)(a−b)
# 
# This Grasshopper component will output two squares: the first with side length
# 
# a+b and the second with side length
# 
# a−b.
panel_2 = Panel(difference_of_two_squares_2.out)  # disabled
# gpt-4 Initial Response
entwine = Entwine(Branch00=geometry, Branch01=geometry_2, FlattenInputs=True)  # disabled
entwine_2 = Entwine(Branch00=geometry_3, Branch01=geometry_4, FlattenInputs=True)
panel_3 = Panel(entwine)  # disabled
panel_4 = Panel(entwine_2)
