# Grasshopper definition 04_003_006_Brahmagupta_Fibonacci_Identity.gh (Grasshopper 1.0.7)
# plug-ins: RhinoCodePluginGH

# ----
# PARAMETRIC SCRIPT
number_slider = Slider(7.2, range=0..10)
# 2nd gpt-4 Text Prompt
# Great, now make the script much more complex model
# with C# script and Rhino common API.
# 
# Be sure to incorporate the previous code logic.
# ensure that this script produces 3d geometry as
# well for Data visualization purposes.
number_slider_2 = Slider(2.72, range=0..10)
number_slider_3 = Slider(1, range=-1..1)
number_slider_4 = Slider(-1, range=-1..1)
# Visualize Mathematics
# with C#  in Grasshopper
# at Wickerson Studios
# 004 ALGEBRA & ARITHMETIC
# 4.3 Algebraic Expansion
# 04_003_06_Brahmagupta_Fibonacci_Identity
# BASIC SCRIPT
# gpt-4 Text Prompt
# Use this script editor template to create a script
#  for the C# node in grasshopper for rhino8 that
# models geometry for the Brahmagupta Fibonacci Identity : //
# Grasshopper Script Instance
# //#! csharp
# using System;
# using System.Collections;
# using System.Collections.Generic;
# using System.Drawing;
# 
# using Rhino;
# using Rhino.Geometry;
# 
# using Grasshopper;
# using Grasshopper.Kernel;
# using Grasshopper.Kernel.Data;
# using Grasshopper.Kernel.Types;
# 
# public class Script_Instance : GH_ScriptInstance
# {
#   /*
#     Members:
#       RhinoDoc RhinoDocument
#       GH_Document GrasshopperDocument
#       IGH_Component Component
#       int Iteration
# 
#     Methods (Virtual & overridable):
#       Print(string text)
#       Print(string format, params object[] args)
#       Reflect(object obj)
#       Reflect(object obj, string method_name)
#   */
# 
#   private void RunScript(object x, object y, out object a)
#   {
#     // Write your logic here
#     a = null;
#   }
# }
brahmagupta_fibonacci_identity = Script(a=number_slider, b=Slider(2.72, range=0..10), c=Slider(7.2, range=0..10), d=number_slider_2)  # -> out, x, y; inputs a: Double, b: Double, c: Double, d: Double
# ---------- brahmagupta_fibonacci_identity: C# ----------
// Grasshopper Script Instance
//#! csharp
using System;
using System.Collections;
using System.Collections.Generic;
using System.Drawing;

using Rhino;
using Rhino.Geometry;

using Grasshopper;
using Grasshopper.Kernel;
using Grasshopper.Kernel.Data;
using Grasshopper.Kernel.Types;

public class Script_Instance : GH_ScriptInstance
{
  /* 
    Members:
      RhinoDoc RhinoDocument
      GH_Document GrasshopperDocument
      IGH_Component Component
      int Iteration

    Methods (Virtual & overridable):
      Print(string text)
      Print(string format, params object[] args)
      Reflect(object obj)
      Reflect(object obj, string method_name)
  */
  
  private void RunScript(double a, double b, double c, double d, out object x, out object y)
  {
    // Brahmagupta Fibonacci Identity
    double result1 = (a * c - b * d) * (a * c - b * d);
    double result2 = (a * d + b * c) * (a * d + b * c);

    x = result1;
    y = result2;
  }
}
# ---------- end brahmagupta_fibonacci_identity ----------
brahmagupta_fibonacci_identity_2 = Script(a=number_slider_3, b=number_slider_4, c=Slider(1, range=-1..1), d=Slider(-0.424, range=-1..1))  # -> out, A, B; inputs a: Double, b: Double, c: Double, d: Double
# ---------- brahmagupta_fibonacci_identity_2: C# ----------
// Grasshopper Script Instance
//#! csharp
using System;
using System.Collections;
using System.Collections.Generic;
using System.Drawing;

using Rhino;
using Rhino.Geometry;

using Grasshopper;
using Grasshopper.Kernel;
using Grasshopper.Kernel.Data;
using Grasshopper.Kernel.Types;

public class Script_Instance : GH_ScriptInstance
{
  /* 
    Members:
      RhinoDoc RhinoDocument
      GH_Document GrasshopperDocument
      IGH_Component Component
      int Iteration

    Methods (Virtual & overridable):
      Print(string text)
      Print(string format, params object[] args)
      Reflect(object obj)
      Reflect(object obj, string method_name)
  */
  
  private void RunScript(double a, double b, double c, double d, out object A, out object B)
  {
    // Brahmagupta Fibonacci Identity
    double result1 = Math.Pow(a * c - b * d, 2);
    double result2 = Math.Pow(a * d + b * c, 2);

    // Create boxes to represent the results
    Box boxA = new Box(Plane.WorldXY, new Interval(0, result1 + result2), new Interval(0, result1), new Interval(0, result2));
    Box boxB = new Box(Plane.WorldXY, new Interval(result1 + result2, 2 * (result1 + result2)), new Interval(0, result2), new Interval(0, result1));

    A = boxA;
    B = boxB;
  }
}
# ---------- end brahmagupta_fibonacci_identity_2 ----------
# Sure, the Brahmagupta Fibonacci Identity
# states that for any two numbers a and b:
#     // Brahmagupta Fibonacci Identity
#     double result1 = (a * c - b * d) * (a * c - b * d);
#     double result2 = (a * d + b * c) * (a * d + b * c);
panel = Panel(brahmagupta_fibonacci_identity.out)
geometry = Geometry(brahmagupta_fibonacci_identity_2.A)
geometry_2 = Geometry(brahmagupta_fibonacci_identity_2.B)
panel_2 = Panel(brahmagupta_fibonacci_identity_2.out)
# gpt-4 Initial Response
# Certainly! Let's take this to the next level by
# visualizing the Brahmagupta Fibonacci Identity
# using 3D geometry in Rhino.
# 
# I'll generate two boxes whose dimensions represent the two sides of the identity. The
# width of each box will be the sum of squares,
# and the depth and height will be individual
# square terms, providing a visual representation
# of the identity.
entwine = Entwine(Branch00=brahmagupta_fibonacci_identity.x, Branch01=brahmagupta_fibonacci_identity.y, FlattenInputs=True)
panel_3 = Panel(entwine)
entwine_2 = Entwine(Branch00=geometry, Branch01=geometry_2, FlattenInputs=True)
panel_4 = Panel(entwine_2)

# ----
# Oscillation Algorithm
# The oscillation algorithm can be use to animate
# any geometry that is driven by a number sliders.
# Simply swap out the number sliders at the
# multiplication node in the oscillation script.
trigger = Trigger(Interval=10, TimerInterval=10, Target=data_recorder)  # disabled
panel_5 = Panel("1")  # disabled
data_recorder = DataRecorder(panel_5, DataLimit=-10, RecordData=False)  # disabled
number_slider_5 = Slider(145, range=0..1000)  # disabled
list_length = ListLength(List=data_recorder)  # disabled
division = Division(A=list_length, B=number_slider_5)  # disabled
cosine = Cosine(Value=division)  # disabled
sine = Sine(Value=division)  # disabled
panel_6 = Panel([sine, cosine])  # disabled
multiplication = Multiplication(A=number_slider_4)  # disabled
multiplication_2 = Multiplication(A=sine, B=number_slider_3)  # disabled
