# Grasshopper definition 04_003_007_Degens_Eight_Square_Identity.gh (Grasshopper 1.0.7)
# plug-ins: RhinoCodePluginGH

# ----
# Oscillation Algorithm
# The oscillation algorithm can be use to animate
# any geometry that is driven by a number sliders.
# Simply swap out the number sliders at the
# multiplication node in the oscillation script.
trigger = Trigger(Interval=10, TimerInterval=10, Target=data_recorder)  # disabled
panel = Panel("1")  # disabled
data_recorder = DataRecorder(panel, DataLimit=-10, RecordData=False)  # disabled
number_slider = Slider(145, range=0..1000)  # disabled
list_length = ListLength(List=data_recorder)  # disabled
division = Division(A=list_length, B=number_slider)  # disabled
cosine = Cosine(Value=division)  # disabled
sine = Sine(Value=division)  # disabled
panel_2 = Panel([sine, cosine])  # disabled
multiplication = Multiplication()  # disabled
multiplication_2 = Multiplication(A=sine)  # disabled

# ----
# PARAMETRIC SCRIPT
number_slider_2 = Slider(23, range=0..100)
# 2nd gpt-4 Text Prompt
# Great, now make the script much more complex model
# with C# script and Rhino common API.
# 
# Be sure to incorporate the previous code logic.
# ensure that this script produces 3d geometry as
# well for Data visualization purposes.
number_slider_3 = Slider(24, range=0..100)  # disabled
degen_s_eight_square_identity = Script(x=number_slider_2)  # -> out, a; inputs x: Int32
# ---------- degen_s_eight_square_identity: C# ----------
// Grasshopper Script Instance
//#! csharp
using System;
using System.Collections;
using System.Collections.Generic;
using System.Drawing;

using Rhino;
using Rhino.Geometry;

using Grasshopper;
using Grasshopper.Kernel;
using Grasshopper.Kernel.Data;
using Grasshopper.Kernel.Types;

public class Script_Instance : GH_ScriptInstance
{
  private void RunScript(int x, out object a)
  {
    int number;
    if (int.TryParse(x.ToString(), out number) && number > 0)
    {
      List<int> squares = SumOfEightSquares(number);
      List<Box> cubes = CreateCubes(squares);
      a = cubes;
    }
    else
    {
      a = "Invalid input. Please input a positive integer.";
    }
  }

  private List<int> SumOfEightSquares(int number)
  {
    List<int> squares = new List<int>();
    while (number > 0 && squares.Count < 8)
    {
      int largestSquare = LargestSquare(number);
      squares.Add(largestSquare);
      number -= largestSquare;
    }
    while (squares.Count < 8) squares.Add(0); 
    return squares;
  }

  private int LargestSquare(int num)
  {
    int i = (int)Math.Floor(Math.Sqrt(num));
    return i * i;
  }

  private List<Box> CreateCubes(List<int> squares)
  {
    List<Box> cubes = new List<Box>();

    int gridDimension = 2;
    double spacing = 5.0;

    for (int i = 0; i < squares.Count; i++)
    {
      double sideLength = Math.Sqrt(squares[i]);
      int xIndex = i % gridDimension;
      int yIndex = (i / gridDimension) % gridDimension;
      int zIndex = i / (gridDimension * gridDimension);

      Point3d basePoint = new Point3d(xIndex * (sideLength + spacing), yIndex * (sideLength + spacing), zIndex * (sideLength + spacing));
      Box cube = new Box(new Plane(basePoint, Vector3d.ZAxis), new Interval(0, sideLength), new Interval(0, sideLength), new Interval(0, sideLength));
      cubes.Add(cube);
    }

    return cubes;
  }
}
# ---------- end degen_s_eight_square_identity ----------
# Visualize Mathematics
# with C#  in Grasshopper
# at Wickerson Studios
# 004 ALGEBRA & ARITHMETIC
# 4.3 Algebraic Expansion
# 04_003_07_Degen's_Eight-Square_Identity
# BASIC SCRIPT
# gpt-4 Text Prompt
# Use this script editor template to create a script
#  for the C# node in grasshopper for rhino8 that
# models geometry for the Degen's Eight-Square  Identity : //
# Grasshopper Script Instance
# //#! csharp
# using System;
# using System.Collections;
# using System.Collections.Generic;
# using System.Drawing;
# 
# using Rhino;
# using Rhino.Geometry;
# 
# using Grasshopper;
# using Grasshopper.Kernel;
# using Grasshopper.Kernel.Data;
# using Grasshopper.Kernel.Types;
# 
# public class Script_Instance : GH_ScriptInstance
# {
#   /*
#     Members:
#       RhinoDoc RhinoDocument
#       GH_Document GrasshopperDocument
#       IGH_Component Component
#       int Iteration
# 
#     Methods (Virtual & overridable):
#       Print(string text)
#       Print(string format, params object[] args)
#       Reflect(object obj)
#       Reflect(object obj, string method_name)
#   */
# 
#   private void RunScript(object x, object y, out object a)
#   {
#     // Write your logic here
#     a = null;
#   }
# }
degen_s_eight_square_identity_2 = Script(x=number_slider_3)  # -> out, a; inputs x: Int32; disabled
# ---------- degen_s_eight_square_identity_2: C# ----------
// Grasshopper Script Instance
//#! csharp
using System;
using System.Collections;
using System.Collections.Generic;
using System.Drawing;

using Rhino;
using Rhino.Geometry;

using Grasshopper;
using Grasshopper.Kernel;
using Grasshopper.Kernel.Data;
using Grasshopper.Kernel.Types;

public class Script_Instance : GH_ScriptInstance
{
  private void RunScript(int x, out object a)
  {
    int number;
    if (int.TryParse(x.ToString(), out number) && number > 0)
    {
      List<int> squares = SumOfEightSquares(number);
      List<Rectangle3d> geometries = new List<Rectangle3d>();

      Point3d basePoint = new Point3d(0, 0, 0);
      for (int i = 0; i < squares.Count; i++)
      {
        double sideLength = Math.Sqrt(squares[i]);
        geometries.Add(new Rectangle3d(new Plane(basePoint, Vector3d.ZAxis), sideLength, sideLength));
        basePoint.Transform(Transform.Translation(new Vector3d(0, sideLength + 5, 0))); // Spacing them vertically by 5 units
      }
      
      a = geometries;
    }
    else
    {
      a = "Invalid input. Please input a positive integer.";
    }
  }

  private List<int> SumOfEightSquares(int number)
  {
    List<int> squares = new List<int>();
    while (number > 0 && squares.Count < 8)
    {
      int largestSquare = LargestSquare(number);
      squares.Add(largestSquare);
      number -= largestSquare;
    }
    while (squares.Count < 8) squares.Add(0); // To make sure we have 8 squares even if they're zero
    return squares;
  }

  private int LargestSquare(int num)
  {
    int i = (int)Math.Floor(Math.Sqrt(num));
    return i * i;
  }
}
# ---------- end degen_s_eight_square_identity_2 ----------
geometry = Geometry(degen_s_eight_square_identity.a)
geometry_2 = Geometry(degen_s_eight_square_identity_2.a)  # disabled
panel_3 = Panel(degen_s_eight_square_identity.out)
# Certainly! Degen's Eight-Square Identity states
# that every positive integer can be expressed as
# the sum of at most eight square numbers.
# However, visualizing this directly could be quite
# challenging.
# 
# For simplicity, let's use this script to demonstrate
#  the sum of eight squares for a given positive
# integer. Here's how we can do it:
# 
# Get a positive integer as an input.
# Find eight squares that sum to the given
# number (this may not be unique).
# Model these squares as geometric squares in
# the Rhino environment.
panel_4 = Panel(degen_s_eight_square_identity_2.out)  # disabled
entwine = Entwine(Branch00=geometry, FlattenInputs=True)
# gpt-4 Initial Response
# Certainly! Let's evolve the code to visualize
# Degen's Eight-Square Identity in 3D.
# 
# Instead of displaying the numbers as 2D
# squares, we'll represent them as 3D cubes in
# the Rhino environment. The size of each cube
# will correspond to the square root of each
# square number, and they will be arranged in
# space to give a better understanding of their
# relationship.
# 
# Here's an approach:
# 
# For each square number in the eight squares,
# we will produce a cube whose edge length
# corresponds to the square root of the number.
# Arrange these cubes in a 2x2x2 grid, thus
# utilizing three dimensions. We'll space them out
# for clarity.
# Color each cube based on its magnitude to give
# additional clarity to the visualization.
entwine_2 = Entwine(Branch00=geometry_2, FlattenInputs=True)  # disabled
panel_5 = Panel(entwine)
panel_6 = Panel(entwine_2)  # disabled
