# Grasshopper definition 04__03_004_Binomial_Expansion.gh (Grasshopper 1.0.7)
# plug-ins: RhinoCodePluginGH

number_slider = Slider(1, range=0..1)  # disabled
number_slider_2 = Slider(3.77, range=0..10)  # disabled
number_slider_3 = Slider(3.22, range=0..10)  # disabled
# Visualize Mathematics
# with C#  in Grasshopper
# at Wickerson Studios
# 004 ALGEBRA & ARITHMETIC
# 4.3 Algebraic Expansion
# 04_03_04_Binomial_Expansion
# BASIC SCRIPT
# gpt-4 Text Prompt
# Use this script editor template to create a script
#  for the C# node in grasshopper for rhino8 that
# models geometry for the Binomial Expansion: //
# Grasshopper Script Instance
# //#! csharp
# using System;
# using System.Collections;
# using System.Collections.Generic;
# using System.Drawing;
# 
# using Rhino;
# using Rhino.Geometry;
# 
# using Grasshopper;
# using Grasshopper.Kernel;
# using Grasshopper.Kernel.Data;
# using Grasshopper.Kernel.Types;
# 
# public class Script_Instance : GH_ScriptInstance
# {
#   /*
#     Members:
#       RhinoDoc RhinoDocument
#       GH_Document GrasshopperDocument
#       IGH_Component Component
#       int Iteration
# 
#     Methods (Virtual & overridable):
#       Print(string text)
#       Print(string format, params object[] args)
#       Reflect(object obj)
#       Reflect(object obj, string method_name)
#   */
# 
#   private void RunScript(object x, object y, out object a)
#   {
#     // Write your logic here
#     a = null;
#   }
# }
number_slider_4 = Slider(4, range=0..10)  # disabled
# PARAMETRIC SCRIPT
number_slider_5 = Slider(4, range=0..10)  # disabled
vector_xyz = VectorXYZ(XComponent=number_slider, YComponent=0, ZComponent=0)  # -> Vector, Length; disabled
construct_point = ConstructPoint(XCoordinate=0, YCoordinate=0, ZCoordinate=0)  # disabled
construct_point_2 = ConstructPoint(XCoordinate=0, YCoordinate=0, ZCoordinate=0)  # disabled
# 2nd gpt-4 Text Prompt
# Great, now make the script much more complex model
# with C# script and Rhino common API.
# 
# Be sure to incorporate the previous code logic.
# ensure that this script produces 3d geometry as
# well for Data visualization purposes.
number_slider_6 = Slider(0.7, range=0..10)
vector_xyz_2 = VectorXYZ(XComponent=Slider(1, range=0..1), YComponent=0, ZComponent=0)  # -> Vector, Length
binomial_expansion = Script(n=number_slider_4, startPoint=construct_point)  # -> out, points; disabled
construct_point_3 = ConstructPoint(XCoordinate=0, YCoordinate=0, ZCoordinate=0)
binomial_expansion_2 = Script(
    n=number_slider_5,
    startPoint=construct_point_2,
    direction=vector_xyz.Vector,
    spacing=number_slider_2,
    multiplier=number_slider_3)  # -> out, points; inputs n: Int32, startPoint: Point3d, direction: Vector3d, spacing: Double, multiplier: Double; disabled
# ---------- binomial_expansion_2: C# ----------
// Grasshopper Script Instance
//#! csharp
using System;
using System.Collections;
using System.Collections.Generic;
using System.Drawing;

using Rhino;
using Rhino.Geometry;

using Grasshopper;
using Grasshopper.Kernel;
using Grasshopper.Kernel.Data;
using Grasshopper.Kernel.Types;

public class Script_Instance : GH_ScriptInstance
{
    private void RunScript(int n, Rhino.Geometry.Point3d startPoint, Rhino.Geometry.Vector3d direction, double spacing, double multiplier, out object points)
    {
        List<Point3d> resultList = new List<Point3d>();

        // Normalize the direction vector and apply spacing
        direction.Unitize();
        Vector3d stepDirection = direction * spacing;

        if (n < 0)
        {
            points = resultList;
            return;
        }

        for (int i = 0; i <= n; i++)
        {
            // Compute binomial coefficient and apply multiplier
            double coeff = BinomialCoefficient(n, i) * multiplier;

            // Position the point based on the coefficient
            Point3d newPoint = startPoint + (stepDirection * i);
            Vector3d heightOffset = Vector3d.ZAxis * coeff;
            newPoint += heightOffset;

            resultList.Add(newPoint);
        }

        points = resultList;
    }

    // Function to compute factorial (used in BinomialCoefficient)
    private double Factorial(int num)
    {
        if (num == 0) return 1;
        double result = 1;
        for (int i = 1; i <= num; i++)
        {
            result *= i;
        }
        return result;
    }

    // Function to compute the binomial coefficient
    private double BinomialCoefficient(int n, int k)
    {
        return Factorial(n) / (Factorial(k) * Factorial(n - k));
    }
}
# ---------- end binomial_expansion_2 ----------
geometry = Geometry(binomial_expansion.points)  # disabled
geometry_2 = Geometry(binomial_expansion_2.points)  # disabled
binomial_expansion_3 = Script(
    n=Slider(6, range=0..10),
    k=Slider(1, range=0..10),
    startPoint=construct_point_3,
    direction=vector_xyz_2.Vector,
    spacing=Slider(1.84, range=0..10),
    multiplier=number_slider_6)  # -> out, allPoints, kPoint; inputs n: Int32, k: Int32, startPoint: Point3d, direction: Vector3d, spacing: Double, multiplier: Double
# ---------- binomial_expansion_3: C# ----------
// Grasshopper Script Instance
//#! csharp
using System;
using System.Collections;
using System.Collections.Generic;
using System.Drawing;

using Rhino;
using Rhino.Geometry;

using Grasshopper;
using Grasshopper.Kernel;
using Grasshopper.Kernel.Data;
using Grasshopper.Kernel.Types;

public class Script_Instance : GH_ScriptInstance
{
    private void RunScript(int n, int k, Rhino.Geometry.Point3d startPoint, Rhino.Geometry.Vector3d direction, double spacing, double multiplier, out object allPoints, out object kPoint)
    {
        List<Point3d> resultList = new List<Point3d>();
        kPoint = Point3d.Unset;

        // Normalize the direction vector and apply spacing
        direction.Unitize();
        Vector3d stepDirection = direction * spacing;

        if (n < 0 || k < 0 || k > n)
        {
            allPoints = resultList;
            return;
        }

        for (int i = 0; i <= n; i++)
        {
            // Compute binomial coefficient and apply multiplier
            double coeff = BinomialCoefficient(n, i) * multiplier;

            // Position the point based on the coefficient
            Point3d newPoint = startPoint + (stepDirection * i);
            Vector3d heightOffset = Vector3d.ZAxis * coeff;
            newPoint += heightOffset;

            resultList.Add(newPoint);

            if (i == k)
            {
                kPoint = newPoint;
            }
        }

        allPoints = resultList;
    }

    // Function to compute factorial (used in BinomialCoefficient)
    private double Factorial(int num)
    {
        if (num == 0) return 1;
        double result = 1;
        for (int i = 1; i <= num; i++)
        {
            result *= i;
        }
        return result;
    }

    // Function to compute the binomial coefficient
    private double BinomialCoefficient(int n, int k)
    {
        return Factorial(n) / (Factorial(k) * Factorial(n - k));
    }
}
# ---------- end binomial_expansion_3 ----------
sphere = Sphere(Base=geometry, Radius=1)  # disabled
sphere_2 = Sphere(Base=geometry_2, Radius=1)  # disabled
# To model geometry for the Binomial Expansion
# using Grasshopper's C# node, I'll illustrate this
# by creating points that correspond to the
# coefficients of the Binomial Expansion. We'll use
#  Pascal's Triangle as a graphical representation
# for the coefficients.
# 
# For example, the expansion of (a+b)^3 would
# give:
# 
# Here, the coefficients are 1, 3, 3, 1. The 3rd row
# of Pascal's triangle is 1, 3, 3, 1.
# 
# Given an integer n (representing the power in
# the expansion), the script would generate points
#  corresponding to the coefficients in the nth row
#  of Pascal's Triangle.
panel = Panel(binomial_expansion.out)  # disabled
panel_2 = Panel(binomial_expansion_2.out)  # disabled
geometry_3 = Geometry(binomial_expansion_3.allPoints)
geometry_4 = Geometry(binomial_expansion_3.kPoint)
entwine = Entwine(Branch00=geometry, Branch01=sphere, FlattenInputs=True)  # disabled
entwine_2 = Entwine(Branch00=geometry_2, Branch01=sphere_2, FlattenInputs=True)  # disabled
sphere_3 = Sphere(Base=geometry_3, Radius=1)
# gpt-4 Initial Response
# Sure! Let's introduce numpy into the equation to
#  achieve a more complex model. I'll make use of
# numpy to generate a field of points around each
#  term of the binomial expansion. The magnitude
# of the field (number of points) will be determined
#  by the coefficient, and then I'll generate a
# Voronoi 3D structure around each term based
# on these points for a more intricate visualization.
# 
# Here's how it's done:
# 
# Use numpy to generate a cloud of random
# points around the term's position.
# Use the coefficient as a magnitude for the
# number of points.
# Use Rhino's Voronoi function to generate the
# Voronoi cells around each term.
sphere_4 = Sphere(Base=geometry_4, Radius=1)
panel_3 = Panel(binomial_expansion_3.out)
panel_4 = Panel(entwine)  # disabled
panel_5 = Panel(entwine_2)  # disabled
entwine_3 = Entwine(Branch00=sphere_3, Branch01=sphere_4, FlattenInputs=True)
panel_6 = Panel(entwine_3)
